# Grasshopper definition 201_SimpleCantileverElem1D.gh (Grasshopper 1.0.7)
# Copyright: Arup
# plug-ins: GSA

pt = ConstructPoint(XCoordinate=Slider(4, range=0..10), YCoordinate=Slider(3, range=0..10), ZCoordinate=Slider(0, range=0..10))
pt_2 = ConstructPoint(XCoordinate=Slider(0, range=0..10), YCoordinate=Slider(2, range=0..10), ZCoordinate=Slider(0, range=0..10))
ln = Line(StartPoint=pt, EndPoint=pt_2)
support = CreateSupport(Point=pt_2, Plane=PlaneXY(0, 0, 0), x=True, xx=True, y=True, yy=True, z=True, zz=True)
elem1d = Create1DElement(Line=ln)
analyse = AnalyseModel(GSAGeometry=[elem1d, support])
savegsa = SaveModel(GSAModel=analyse)
