# Grasshopper definition 402_Analysis_Surface.gh (Grasshopper 1.0.7)
# Copyright: Arup
# plug-ins: GSA

panel = Panel("C:\Users\Kristjan.Nielsen\Desktop\GSA-Grasshoppe\BaseModel.gwb")
open = OpenModel(FilenameAndPath=panel, File="C:\Users\Kristjan.Nielsen\Desktop\GSA-Grasshoppe\BaseModel.gwb")
pt = ConstructPoint(XCoordinate=Slider(-4.6, range=-5..5), YCoordinate=Slider(2.1, range=-5..5), ZCoordinate=0)
pt_2 = ConstructPoint(XCoordinate=Slider(1.1, range=-5..5), YCoordinate=Slider(3.5, range=-5..5), ZCoordinate=0)
pt_3 = ConstructPoint(XCoordinate=Slider(0.1, range=-5..5), YCoordinate=Slider(-4.2, range=-5..5), ZCoordinate=0)
pt_4 = ConstructPoint(XCoordinate=Slider(-5, range=-5..5), YCoordinate=Slider(-5, range=-5..5), ZCoordinate=0)
srf4pt = _4PointSurface(CornerA=pt_4, CornerB=pt, CornerC=pt_2, CornerD=pt_3)
pt_5 = Point([pt_4, pt, pt_2, pt_3])
mem2d = Create2DMember(Brep=srf4pt, MeshSize=Slider(0.5, range=0..1))
support = CreateSupport(Point=pt_5, Plane=PlaneXY(0, 0, 0), x=True, xx=False, y=True, yy=False, z=True, zz=True)
gravityload = CreateGravityLoad(LoadCase=1, ElementList="All", GravityFactor=Vector(0, 0, -1))
faceload = CreateFaceLoad(LoadCase=1, ElementList="all", Axis=-1, Direction="z", Projected=False, ValueKNM²=Slider(5, range=0..10), Mode=0)
gsa = GSAModel(open)
analyse = AnalyseModel(ModelS=gsa, GSAGeometry=[support, mem2d], GSALoad=[gravityload, faceload])
series = Series(Start=0, Step="0.1", Count=10)
gradient = Gradient(LowerLimit="0", UpperLimit="1", Parameter=series, stops=[0: RGB(0, 128, 0), 0.5: RGB(255, 255, 0), 1: RGB(255, 0, 0)])
elem2dresults = _2DElementResults(GSAModel=analyse, LoadCase=1, ElementFilterList="All", Colour=gradient, Display=5, Mode=1, flayer=0)  # -> Force, Moment, Mesh, Colours, Values
noderesult = NodeResults(GSAModel=analyse, LoadCase=1, NodeFilterList="All", Scalar=10, Display=3, Mode=1)  # -> Force, Moment, Point, Co, Colours, Values
devec = DeconstructVector(Vector=elem2dresults.Force)  # -> XComponent, YComponent, ZComponent
legend = Legend(Colour=elem2dresults.Colours, Tags=elem2dresults.Values, LegendType=1)
panel_2 = Panel(devec.XComponent)
panel_3 = Panel(devec.YComponent)
panel_4 = Panel(devec.ZComponent)
