# Grasshopper definition CreateEdit3dPropElemAndMem.gh (Grasshopper 1.0.7)
# Copyright: Arup
# plug-ins: GSA

size = Slider(3, range=0..100)
movefact = Slider(0.5, range=0.1..0.9)
pt = ConstructPoint(XCoordinate=0, YCoordinate=0, ZCoordinate=0)
pt_2 = ConstructPoint(XCoordinate=size, YCoordinate=size, ZCoordinate=size)
multiplication = Multiplication(A=size, B=movefact)
vec = VectorXYZ(XComponent=multiplication, YComponent=multiplication, ZComponent=multiplication)  # -> Vector, Length
box = Box2Pt(PointA=pt, PointB=pt_2, Plane=PlaneXY(0, 0, 0))
material = CustomMaterial(
    ElasticModulus_MPa="18000",
    PoissonsRatio="0.3",
    Density_kg_m³="2400",
    Material_Type="Concrete",
    Stress_Unit="MPa",
    Density_Unit="kg/m³",
    Temperature_Unit="°C")
material_2 = CustomMaterial(
    ElasticModulus_MPa="8000",
    PoissonsRatio="0.15",
    Density_kg_m³="750",
    Material_Type="Timber",
    Stress_Unit="MPa",
    Density_Unit="kg/m³",
    Temperature_Unit="°C")
move = Move(Geometry=box, Motion=vec.Vector)  # -> Geometry, Transform
sunion = SolidUnion(Breps=[box, move.Geometry])
prop3d = Create3DProperty(Material=material)
mem3d = Create3DMember(Solid=sunion, Prop3D=prop3d)
prop3dedit = Edit3DProperty(
    Prop3D=prop3d,
    Prop3dNumber="4",
    Material=material_2,
    Axis="1",
    Prop3dName="Timber",
    Prop3dColour=ColourSwatch(SwatchColor=RGB(255, 242, 0)))  # -> Prop3D, Prop2dNumber, Material, Axis, Prop3dName, Prop3dColour
elemfrommem = ElementsFromMembers(_3DMembers_m=mem3d, Tolerance=0.01, Unit="m")  # -> Nodes, _1DElements, _2DElements, _3DElements, GSAModel
matprop = MaterialProperties(
    Material=prop3dedit.Material,
    DensityUnit="KilogramPerCubicMeter",
    StressUnit="Megapascal",
    TemperatureUnit="DegreeCelsius")  # -> ElasticModulus_MPa, PoissonsRatio, Density_kg_m³, ThermalExpansion_C_¹
elem3dedit = Edit3DElement(Element3D=elemfrommem._3DElements, _3DProperty=prop3dedit.Prop3D)  # -> Element3D, Number, AnalysisMesh, _3DProperty, Group, ElementType, Name, Colour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
num = Number(matprop.ElasticModulus_MPa)
num_2 = Number(matprop.PoissonsRatio)
num_3 = Number(matprop.Density_kg_m³)
num_4 = Number(matprop.ThermalExpansion_C_¹)
prop3dedit_2 = Edit3DProperty(Prop3D=elem3dedit._3DProperty)  # -> Prop3D, Prop2dNumber, Material, Axis, Prop3dName, Prop3dColour
lng = ListLength(List=elem3dedit.Number)

# ---- group: MeshCount
int = Integer(lng)

# ----
matprop_2 = MaterialProperties(
    Material=prop3dedit_2.Material,
    DensityUnit="KilogramPerCubicMeter",
    StressUnit="Megapascal",
    TemperatureUnit="DegreeCelsius")  # -> ElasticModulus_MPa, PoissonsRatio, Density_kg_m³, ThermalExpansion_C_¹
int_2 = Integer(prop3dedit_2.Prop2dNumber)

# ---- group: Material
txt = Text(prop3dedit_2.Prop3dName)

# ----
num_5 = Number(matprop_2.ElasticModulus_MPa)
num_6 = Number(matprop_2.PoissonsRatio)
num_7 = Number(matprop_2.Density_kg_m³)
num_8 = Number(matprop_2.ThermalExpansion_C_¹)

# ---- group: zero if all are true
equals = Equality(FirstNumber=int_2, SecondNumber=prop3dedit.Prop2dNumber)  # -> Equality, Inequality
equals_2 = Equality(FirstNumber=num_5, SecondNumber=num)  # -> Equality, Inequality
equals_3 = Equality(FirstNumber=num_8, SecondNumber=num_4)  # -> Equality, Inequality
equals_4 = Equality(FirstNumber=num_6, SecondNumber=num_2)  # -> Equality, Inequality
equals_5 = Equality(FirstNumber=num_7, SecondNumber=num_3)  # -> Equality, Inequality
equals_6 = Equality(FirstNumber=prop3dedit_2.Axis, SecondNumber=prop3dedit.Axis)  # -> Equality, Inequality
ma = MassAddition(Input=[equals.Inequality, equals_2.Inequality, equals_4.Inequality, equals_5.Inequality, equals_3.Inequality, equals_6.Inequality])  # -> Result, PartialResults

# ---- group: Test
int_3 = Integer(ma.Result)

# ----
panel = Panel(int_3)
