# Grasshopper definition Elem1dResults.gh (Grasshopper 1.0.7)
# Copyright: Arup
# plug-ins: GSA

panel = Panel("https://samples.oasys-software.com/gsa/10.1/Training_General/TrGen_10.gwb")
c_script = CSharpScript(x=panel)  # -> A; inputs x: String
# ---------- c_script: C# usings ----------
using System.Linq;
# ---------- c_script: C# ----------
    string filePath = System.IO.Path.GetTempPath();
    string fileName = x.Split('/').Last();
    //create webclient and download example file:
    System.Net.WebClient webClient = new System.Net.WebClient();
    webClient.DownloadFile(
      x,
      filePath + fileName);

    A = filePath + fileName;
# ---------- end c_script ----------
open = OpenModel(FilenameAndPath=c_script, File="C:\Users\kristjan.nielsen\AppData\Local\Temp\TrGen_10.gwb")
analyse = AnalyseModel(ModelS=open, Analyse=True, ReMesh=True, Tolerance=0.05, Unit="m")
gsa = Model(analyse)
series = Series(Start="1", Step=1, Count="22")
selres = SelectResults(GSAModel=analyse, Type="AnalysisCase", Case_ID="A3")
selres_2 = SelectResults(GSAModel=gsa, Type="AnalysisCase", Case_ID="A2")
selres_3 = SelectResults(GSAModel=gsa, Type="AnalysisCase", Case_ID="A1")
selres_4 = SelectResults(GSAModel=gsa, Case=series, Type="AnalysisCase", Case_ID="A22")
addition = Addition(A="7", B="2")
beamdisp = BeamDisplacements(Result=selres, ElementFilterList="5", IntermediatePoints=3, Unit="mm")  # -> TranslationsX_mm, TranslationsY_mm, TranslationsZ_mm, TranslationsXYZ_mm, RotationsXX_rad, RotationsYY_rad, RotationsZZ_rad, RotationsXYZ_rad
beamforces = BeamForcesAndMoments(Result=selres_2, ElementFilterList="All", IntermediatePoints="7", Force_Unit="kN", Moment_Unit="kN·m")  # -> ForceX_kN, ForceY_kN, ForceZ_kN, ForceXYZ_kN, MomentXX_kN_m, MomentYY_kN_m, MomentZZ_kN_m, MomentXXYYZZ_kN_m
strainenergy = BeamStrainEnergyDensity(Result=selres_4, ElementFilterList="1363", IntermediatePoints="3", checked=False, Energy_Unit="MJ")  # -> flatten(StrainEnergyDensity_MJ_m³)
strainenergy_2 = BeamStrainEnergyDensity(Result=selres_3, ElementFilterList="All", checked=True, Energy_Unit="J")  # -> flatten(StrainEnergyDensity_J_m³)
path = ConstructPath(Indices=["2", "0", "9"])
series_2 = Series(Start=0, Step=1, Count=addition)
item = TreeItem(Tree=beamforces.ForceXYZ_kN, Path=path, Index=series_2, Wrap=True)
item_2 = TreeItem(Tree=beamforces.ForceX_kN, Path=path, Index=series_2, Wrap=True)
item_3 = TreeItem(Tree=beamforces.MomentXX_kN_m, Path=path, Index=series_2, Wrap=True)
item_4 = TreeItem(Tree=beamforces.ForceY_kN, Path=path, Index=series_2, Wrap=True)
item_5 = TreeItem(Tree=beamforces.ForceZ_kN, Path=path, Index=series_2, Wrap=True)
item_6 = TreeItem(Tree=beamforces.MomentYY_kN_m, Path=path, Index=series_2, Wrap=True)
item_7 = TreeItem(Tree=beamforces.MomentZZ_kN_m, Path=path, Index=series_2, Wrap=True)
item_8 = TreeItem(Tree=beamforces.MomentXXYYZZ_kN_m, Path=path, Index=series_2, Wrap=True)

# ---- group: Ux
num = Number(beamdisp.TranslationsX_mm)

# ---- group: Uy
num_2 = Number(beamdisp.TranslationsY_mm)

# ---- group: Uz
num_3 = Number(beamdisp.TranslationsZ_mm)

# ---- group: U
num_4 = Number(beamdisp.TranslationsXYZ_mm)

# ---- group: Rxx
num_5 = Number(beamdisp.RotationsXX_rad)

# ---- group: Ryy
num_6 = Number(beamdisp.RotationsYY_rad)

# ---- group: Rzz
num_7 = Number(beamdisp.RotationsZZ_rad)

# ---- group: R
num_8 = Number(beamdisp.RotationsXYZ_rad)

# ---- group: Fx
num_9 = Number(item_2)

# ---- group: Fy
num_10 = Number(item_4)

# ---- group: Fz
num_11 = Number(item_5)

# ---- group: Fyz
num_12 = Number(item)

# ---- group: Mxx
num_13 = Number(item_3)

# ---- group: Myy
num_14 = Number(item_6)

# ---- group: Mzz
num_15 = Number(item_7)

# ---- group: Myz
num_16 = Number(item_8)

# ---- group: AvgStrainEnergyDensity
num_17 = Number(strainenergy_2)

# ---- group: StrainEnergyDensity
num_18 = Number(strainenergy)

# ----
panel_2 = Panel(num)
panel_3 = Panel(num_2)
panel_4 = Panel(num_3)
panel_5 = Panel(num_4)
panel_6 = Panel(num_5)
panel_7 = Panel(num_6)
panel_8 = Panel(num_7)
panel_9 = Panel(num_9)
panel_10 = Panel(num_8)
panel_11 = Panel(num_10)
panel_12 = Panel(num_11)
panel_13 = Panel(num_12)
panel_14 = Panel(num_18)
panel_15 = Panel(num_13)
panel_16 = Panel(num_14)
panel_17 = Panel(num_15)
panel_18 = Panel(num_17)
panel_19 = Panel(num_16)
