# Grasshopper definition NodeReactionForceResult.gh (Grasshopper 1.0.7)
# plug-ins: GSA

# ---- group: Chord sections
material = CustomMaterial(
    ElasticModulus_MPa="210000",
    PoissonsRatio=".3",
    Density_kg_m³="7850",
    Material_Type="Steel",
    Stress_Unit="Megapascal",
    Density_Unit="KilogramPerCubicMeter",
    Temperature_Unit="DegreeCelsius")
profile = CreateProfile(
    NumberOfInputs=0,
    catalogueIndex=3,
    inclSS=False,
    lengthUnit="Centimeter",
    mode="Catalogue",
    Profile_type="Catalogue",
    Catalogue="Europrofile",
    Type="EP HE beams",
    Profile="HE HE450.B",
    typeIndex=27)
section = CreateSection(Profile=profile, Material=material)

# ----
number_slider = Slider(15, range=0..100)
pt = ConstructPoint(XCoordinate=0, YCoordinate=number_slider, ZCoordinate=0)
pt_2 = ConstructPoint(XCoordinate=0, YCoordinate=0, ZCoordinate=0)
ln = Line(StartPoint=pt_2, EndPoint=pt)
mem1d = Create1DMember(
    Curve=ln,
    Section=section,
    x1=False,
    x2=False,
    xx1=False,
    xx2=False,
    y1=False,
    y2=False,
    yy1=False,
    yy2=False,
    z1=False,
    z2=False,
    zz1=False,
    zz2=False)
division = Division(A=number_slider, B=Slider(9, range=9..30))
Z = UnitZ(Factor=division)
support = CreateSupport(Point=pt_2, Plane=PlaneXY(0, 0, 0), x=True, xx=True, y=True, yy=True, z=True, zz=True)

# ---- group: Vertical sections
material_2 = CustomMaterial(
    ElasticModulus_MPa="210000",
    PoissonsRatio=".3",
    Density_kg_m³="7850",
    Material_Type="Steel",
    Stress_Unit="Megapascal",
    Density_Unit="KilogramPerCubicMeter",
    Temperature_Unit="DegreeCelsius")
profile_2 = CreateProfile(
    NumberOfInputs=0,
    catalogueIndex=3,
    inclSS=False,
    lengthUnit="Centimeter",
    mode="Catalogue",
    Profile_type="Catalogue",
    Catalogue="Europrofile",
    Type="EP HE beams",
    Profile="HE HE100.A",
    typeIndex=27)
section_2 = CreateSection(Profile=profile_2, Material=material_2)

# ----
move = Move(Geometry=support, Motion=Z)  # -> Geometry, Transform
move_2 = Move(Geometry=mem1d, Motion=Z)  # -> Geometry, Transform
divide = DivideCurve(Curve=move_2.Geometry, Count=Slider(7, range=5..15), Kinks=False)  # -> Points, Tangents, Parameters
rev = Reverse(Vector=Z)
no = Node([move.Geometry, support])
line = LineSDL(Start=divide.Points, Direction=rev, Length=rev)
m1d = _1DMember([mem1d, move_2.Geometry])
end = EndPoints(Curve=line)  # -> Start, End
shift = ShiftList(List=end.End, Shift=1, Wrap=False)
ln_2 = Line(StartPoint=divide.Points, EndPoint=shift)
X = UnitX(Factor=Slider(3, range=0..10))
no_2 = Node(no)
line_2 = LineSDL(Start=divide.Points, Direction=X, Length=X)
move_3 = Move(Geometry=no_2, Motion=X)  # -> Geometry, Transform
mem1d_2 = Create1DMember(
    Curve=[ln_2, line],
    Section=section_2,
    x1=False,
    x2=False,
    xx1=False,
    xx2=False,
    y1=False,
    y2=False,
    yy1=False,
    yy2=False,
    z1=False,
    z2=False,
    zz1=False,
    zz2=False)
no_3 = Node([no_2, move_3.Geometry])
mem1d_3 = Create1DMember(
    Curve=line_2,
    Section=section_2,
    x1=False,
    x2=False,
    xx1=False,
    xx2=False,
    y1=False,
    y2=False,
    yy1=False,
    yy2=False,
    z1=False,
    z2=False,
    zz1=False,
    zz2=False)
m1d_2 = _1DMember([m1d, mem1d_2])
move_4 = Move(Geometry=m1d_2, Motion=X)  # -> Geometry, Transform
m1d_3 = _1DMember([m1d_2, move_4.Geometry])
gravityload = CreateGravityLoad(LoadCase=1, GravityFactor=Vector(0, 0, -1))
analyse = AnalyseModel(
    GSAGeometryIn_m=flatten([no_3, m1d_3, mem1d_3]),
    Loads=gravityload,
    Analyse=True,
    ReMesh=True,
    Tolerance=0.05,
    Geometry_Unit="Meter")
selres = SelectResults(GSAModel=analyse, RT="A", Case="1", Type="AnalysisCase", Case_ID="A1")
res = Result(selres)
reacforce = ReactionForces(Result=res, NodeFilterList="All", Force_Unit="kN", Moment_Unit="kN·m")  # -> ForceX_kN, ForceY_kN, ForceZ_kN, ForceXYZ_kN, MomentXX_kN_m, MomentYY_kN_m, MomentZZ_kN_m, MomentXXYYZZ_kN_m, NodesIDs

# ---- group: Fx
num = Number(reacforce.ForceX_kN)

# ---- group: Fy
num_2 = Number(reacforce.ForceY_kN)

# ---- group: F
num_3 = Number(reacforce.ForceXYZ_kN)

# ---- group: Mzz
num_4 = Number(reacforce.MomentZZ_kN_m)

# ---- group: Fz
num_5 = Number(reacforce.ForceZ_kN)

# ---- group: Mxx
num_6 = Number(reacforce.MomentXX_kN_m)

# ---- group: M
num_7 = Number(reacforce.MomentXXYYZZ_kN_m)

# ---- group: Myy
num_8 = Number(reacforce.MomentYY_kN_m)

# ----
fx = Panel(num)
fy = Panel(num_2)
fz = Panel(num_5)
F = Panel(num_3)
mzz = Panel(num_4)
mxx = Panel(num_6)
myy = Panel(num_8)
M = Panel(num_7)
