# Grasshopper definition GsaGH_Example6_3dBoxes.gh (Grasshopper 1.0.7)
# Copyright: Arup
# plug-ins: GSA

size = Slider(15, range=0..100)
movefact = Slider(0.5, range=0.1..0.9)
pt = ConstructPoint(XCoordinate=0, YCoordinate=0, ZCoordinate=0)
pt_2 = ConstructPoint(XCoordinate=size, YCoordinate=size, ZCoordinate=size)
multiplication = Multiplication(A=size, B=movefact)
vec = VectorXYZ(XComponent=multiplication, YComponent=multiplication, ZComponent=multiplication)  # -> Vector, Length
box = Box2Pt(PointA=pt, PointB=pt_2, Plane=PlaneXY(0, 0, 0))
material = CustomMaterial(
    ElasticModulus_MPa="18000",
    PoissonsRatio="0.3",
    Density_kg_m³="1200",
    Material_Type="Concrete",
    Stress_Unit="MPa",
    Density_Unit="kg/m³",
    Temperature_Unit="°C")
move = Move(Geometry=box, Motion=vec.Vector)  # -> Geometry, Transform
sunion = SolidUnion(Breps=[box, move.Geometry])
mem3d = Create3DMember(Solid=sunion, Prop3D=material)
elemfrommem = ElementsFromMembers(_3DMembers_m=mem3d, Tolerance=0.05, Unit="m")  # -> Nodes, _1DElements, _2DElements, _3DElements, GSAModel
no = Node(elemfrommem.Nodes)
pdecon = Deconstruct(Point=no)  # -> XComponent, YComponent, ZComponent
equals = Equality(FirstNumber=pdecon.ZComponent, SecondNumber="0")  # -> Equality, Inequality
cull = CullPattern(List=no, CullPattern=equals.Equality)
Y = UnitY(Factor=Slider(7, range=0..100))
support = CreateSupport(Point=cull, Plane=PlaneXY(0, 0, 0), x=True, xx=True, y=True, yy=True, z=True, zz=True)
gravityload = CreateGravityLoad(LoadCase=1, GravityFactor=Y)
analyse = AnalyseModel(
    GSAGeometryIn_m=[elemfrommem._3DElements, support],
    Load=gravityload,
    Analyse=True,
    ReMesh=False,
    Tolerance=0.05,
    Unit="m")
selres = SelectResults(GSAModel=analyse, Type="AnalysisCase", Case_ID="A1")
contourelem3d = _3DContourResults(
    Result=selres,
    ElementFilterList="All",
    Display=3,
    Mode=0,
    legend=True,
    length="mm",
    model="m",
    noDec=0,
    Result_Type="Displacement",
    Component="Resolved |U|",
    slider=True,
    stress="MPa",
    val=300,
    valMax=1000,
    valMin=0)  # -> NgonMesh, Colours, Values_mm
disp3d = _3DDisplacements(Result=selres, ElementFilterList="All", Unit="mm")  # -> TranslationsX_mm, TranslationsY_mm, TranslationsZ_mm, flatten(TranslationsXYZ_mm), RotationsXX_rad, RotationsYY_rad, RotationsZZ_rad, RotationsXYZ_rad
demesh = DeconstructMesh(Mesh=contourelem3d.NgonMesh)  # -> Vertices, Faces, Colours, Normals
box_corners = BoxCorners(Box=sunion)  # -> CornerA, CornerB, CornerC, CornerD, CornerE, CornerF, CornerG, CornerH
sort = SortList(Keys=disp3d.TranslationsXYZ_mm)  # -> Keys, ValuesA

# ---- group: Max deflection
item = ListItem(List=reverse(sort.Keys), Index=0, Wrap=True)

# ---- group: Max deflection deformed point
item_2 = ListItem(List=demesh.Vertices, Index="27", Wrap=True)

# ---- group: Original point
pt_3 = Point(box_corners.CornerG)

# ----
num = Number(item)
dist = Distance(PointA=item_2, PointB=pt_3)

# ---- group: Scale by deform shape slider scalar
multiplication_2 = Multiplication(A=num, B="300")

# ---- group: Scale to [mm]
multiplication_3 = Multiplication(A=dist, B="1000")

# ---- group: TestMaxValue
num_2 = Number(multiplication_2)

# ---- group: TestDeflectedShape
num_3 = Number(multiplication_3)

# ----
panel = Panel(num_2)
panel_2 = Panel(num_3)
