# Grasshopper definition SectionModifierTests.gh (Grasshopper 1.0.7)
# Copyright: Arup
# plug-ins: GSA, UnitNumber

profile = CreateProfile(
    Depth_cm="60",
    Width_cm="60",
    NumberOfInputs=2,
    catalogueIndex=-1,
    inclSS=False,
    lengthUnit="Centimeter",
    mode="Other",
    Profile_type="Rectangle",
    Measure="cm",
    typeIndex=-1)
createunit = CreateUnitNumber(Number=Slider(0.7, range=0..1), Unit_type="Ratio", Measure="DecimalFraction")
sectprop = SectionProperties(Section=profile, LengthUnit="Centimeter")  # -> Area_cm², MomentOfInertiaYY_cm⁴, MomentOfInertiaZZ_cm⁴, MomentOfInertiaYZ_cm⁴, TorsionConstant_cm⁴, ShearAreaFactorInY, ShearAreaFactorInZ, SurfaceALength_m²_m, VolumeLength_m³_m
toggle = BooleanToggle(True)
profile_2 = CreateProfile(
    Depth_cm="40",
    Width_cm="40",
    NumberOfInputs=2,
    catalogueIndex=-1,
    inclSS=False,
    lengthUnit="Centimeter",
    mode="Other",
    Profile_type="Rectangle",
    Measure="cm",
    typeIndex=-1)
profile_3 = CreateProfile(
    Depth_cm="40",
    Width_cm="40",
    NumberOfInputs=2,
    catalogueIndex=-1,
    inclSS=False,
    lengthUnit="Centimeter",
    mode="Other",
    Profile_type="Rectangle",
    Measure="cm",
    typeIndex=-1)
sectionmodifier = CreateSectionModifier(
    AreaModifier_cm²=sectprop.Area_cm²,
    I11Modifier_cm⁴=sectprop.MomentOfInertiaYY_cm⁴,
    I22Modifier_cm⁴=sectprop.MomentOfInertiaZZ_cm⁴,
    JModifier_cm⁴=sectprop.TorsionConstant_cm⁴,
    K11Modifier_=sectprop.ShearAreaFactorInY,
    K22Modifier_=sectprop.ShearAreaFactorInZ,
    VolumeModifier_m³_m=sectprop.VolumeLength_m³_m,
    AdditionalMass_kg_m=Slider(500, range=0..1000),
    PrincipalBendingAxis=Toggle(False),
    ReferencePointCentroid=Toggle(False),
    Modify_type="Modify to",
    Length_unit="Centimeter",
    Density_unit="kg/m",
    Stress_calc="Use modified",
    toMode=True)
sectionmodifier_2 = CreateSectionModifier(
    AreaModifier=Slider(0.5, range=0..1),
    I11Modifier="105 %",
    I22Modifier=createunit,
    JModifier=Slider(0.3, range=0..1),
    K11Modifier=Slider(0.35, range=0..1),
    K22Modifier=Slider(0.45, range=0..1),
    VolumeModifier=Slider(0.9, range=0..1),
    AdditionalMass_kg_m=Slider(1250, range=0..10000),
    PrincipalBendingAxis=toggle,
    ReferencePointCentroid=toggle,
    Modify_type="Modify by",
    Density_unit="kg/m",
    Stress_calc="Use unmodified",
    toMode=False)
pt = ConstructPoint(XCoordinate=0, YCoordinate=0, ZCoordinate=0)
sectionedit = EditSection(SectionProfile=profile_3, SectionModifier=sectionmodifier)  # -> Section, SectionNumber, SectionProfile, Material, SectionModifier, SectionPool, SectionName, SectionColour
sectionedit_2 = EditSection(SectionProfile=profile_2, SectionModifier=sectionmodifier_2)  # -> Section, SectionNumber, SectionProfile, Material, SectionModifier, SectionPool, SectionName, SectionColour
line = LineSDL(Start=pt, Direction=Vector(0, 0, 1), Length=1)
elem1d = Create1DElement(Line=line, Section=sectionedit.Section)
model = CreateModel(Properties=sectionedit_2.Section, GSAGeometryIn_m=elem1d, ReMesh=True, Tolerance=0.05, Unit="m")
getgeo = GetModelGeometry(GSAModel=model, NodeFilterList="All", ElementFilterList="All", MemberFilterList="All", Mode=1, Unit="m")  # -> Nodes_m, _1DElements_m, _2DElements_m, _3DElements_m, _1DMembers_m, _2DMembers_m, _3DMembers_m
elem1dedit = Edit1DElement(Element1D=getgeo._1DElements_m)  # -> Element1D, Number, Line, Section, Group, Type, Offset, StartRelease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
sectionedit_3 = EditSection(Section=elem1dedit.Section)  # -> Section, SectionNumber, SectionProfile, Material, SectionModifier, SectionPool, SectionName, SectionColour
getprops = GetModelProperties(GSAModel=model)  # -> Sections, _2DProperties, _3DProperties, CustomMaterials
item = ListItem(List=getprops.Sections, Index=0, Wrap=True)
modifieredit = EditSectionModifier(SectionModifier=sectionedit_3.SectionModifier, DensityUnit="KilogramPerMeter", LengthUnit="Centimeter")  # -> SectionModifier, AreaModifier_cm², I11Modifier_cm⁴, I22Modifier_cm⁴, JModifier, K11Modifier, K22Modifier, VolumeModifier_m³_m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
modifieredit_2 = EditSectionModifier(SectionModifier=item, DensityUnit="KilogramPerMeter", LengthUnit="Centimeter")  # -> SectionModifier, AreaModifier_cm², I11Modifier_cm⁴, I22Modifier_cm⁴, JModifier, K11Modifier, K22Modifier, VolumeModifier_m³_m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

# ---- group: TObooleans
bool = Boolean([modifieredit.PrincipalBendingAxis, modifieredit.ReferencePointCentroid])

# ---- group: TOvalues
num = Number([modifieredit.AreaModifier_cm², modifieredit.I11Modifier_cm⁴, modifieredit.I22Modifier_cm⁴, modifieredit.JModifier, modifieredit.K11Modifier, modifieredit.K22Modifier, modifieredit.VolumeModifier_m³_m, modifieredit.AdditionalMass_kg_m])

# ---- group: TOstressOption
int = Integer(modifieredit.StressOptionType)

# ---- group: BYbooleans
bool_2 = Boolean([modifieredit_2.PrincipalBendingAxis, modifieredit_2.ReferencePointCentroid])

# ---- group: BYvalues
num_2 = Number([modifieredit_2.AreaModifier_cm², modifieredit_2.I11Modifier_cm⁴, modifieredit_2.I22Modifier_cm⁴, modifieredit_2.JModifier, modifieredit_2.K11Modifier, modifieredit_2.K22Modifier, modifieredit_2.VolumeModifier_m³_m, modifieredit_2.AdditionalMass_kg_m])

# ---- group: BYstressOption
int_2 = Integer(modifieredit_2.StressOptionType)

# ----
panel = Panel(num)
panel_2 = Panel(bool)
panel_3 = Panel(int)
panel_4 = Panel(num_2)
panel_5 = Panel(bool_2)
panel_6 = Panel(int_2)
modifieredit_3 = EditSectionModifier(
    SectionModifier=modifieredit_2.SectionModifier,
    AreaModifier=modifieredit.AreaModifier_cm²,
    I11Modifier=modifieredit.I11Modifier_cm⁴,
    I22Modifier=modifieredit.I22Modifier_cm⁴,
    JModifier=modifieredit.JModifier,
    K11Modifier=modifieredit.K11Modifier,
    K22Modifier=modifieredit.K22Modifier,
    VolumeModifier=modifieredit.VolumeModifier_m³_m,
    AdditionalMass=Slider(500, range=0..1000),
    DensityUnit="KilogramPerMeter",
    LengthUnit="Centimeter")  # -> SectionModifier, AreaModifier_cm², I11Modifier_cm⁴, I22Modifier_cm⁴, JModifier, K11Modifier, K22Modifier, VolumeModifier_m³_m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
modifieredit_4 = EditSectionModifier(
    SectionModifier=modifieredit.SectionModifier,
    AreaModifier=modifieredit_2.AreaModifier_cm²,
    I11Modifier=modifieredit_2.I11Modifier_cm⁴,
    I22Modifier=modifieredit_2.I22Modifier_cm⁴,
    JModifier=modifieredit_2.JModifier,
    K11Modifier=modifieredit_2.K11Modifier,
    K22Modifier=modifieredit_2.K22Modifier,
    VolumeModifier=modifieredit_2.VolumeModifier_m³_m,
    AdditionalMass="450 kg/m",
    PrincipalBendingAxis=Toggle(False),
    ReferencePointCentroid=Toggle(False),
    StressOptionType="1",
    DensityUnit="KilogramPerMeter",
    LengthUnit="Centimeter")  # -> SectionModifier, AreaModifier_cm², I11Modifier_cm⁴, I22Modifier_cm⁴, JModifier, K11Modifier, K22Modifier, VolumeModifier_m³_m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

# ---- group: ModBYbooleans
bool_3 = Boolean([modifieredit_3.PrincipalBendingAxis, modifieredit_3.ReferencePointCentroid])

# ---- group: ModBYvalues
num_3 = Number([modifieredit_3.AreaModifier_cm², modifieredit_3.I11Modifier_cm⁴, modifieredit_3.I22Modifier_cm⁴, modifieredit_3.JModifier, modifieredit_3.K11Modifier, modifieredit_3.K22Modifier, modifieredit_3.VolumeModifier_m³_m, modifieredit_3.AdditionalMass_kg_m])

# ---- group: ModBYstressOption
int_3 = Integer(modifieredit_3.StressOptionType)

# ---- group: ModTObooleans
bool_4 = Boolean([modifieredit_4.PrincipalBendingAxis, modifieredit_4.ReferencePointCentroid])

# ---- group: ModTOvalues
num_4 = Number([modifieredit_4.AreaModifier_cm², modifieredit_4.I11Modifier_cm⁴, modifieredit_4.I22Modifier_cm⁴, modifieredit_4.JModifier, modifieredit_4.K11Modifier, modifieredit_4.K22Modifier, modifieredit_4.VolumeModifier_m³_m, modifieredit_4.AdditionalMass_kg_m])

# ---- group: ModTOstressOption
int_4 = Integer(modifieredit_4.StressOptionType)

# ----
panel_7 = Panel(num_3)
panel_8 = Panel(bool_3)
panel_9 = Panel(int_3)
panel_10 = Panel(num_4)
panel_11 = Panel(bool_4)
panel_12 = Panel(int_4)
